# Grasshopper definition Curve Geometry Hops.gh (Grasshopper 1.0.7)
# plug-ins: Bifocals

number_slider = Slider(10, range=0..10)
crv = Curve(<curve referenced from the Rhino model>)
count = GetInteger(AtLeast=1, AtMost=1, Maximum=2147483647, Minimum=-2147483648)
curve = GetGeometry(AtLeast=1, AtMost=1, DeleteInput=False, Filter=1074004029)
divide = DivideCurve(Curve=curve, Count=count, Kinks=False)  # -> Points, Tangents, Parameters
rev = ReverseList(List=divide.Points)
ln = Line(StartPoint=divide.Points, EndPoint=rev)
context_bake = ContextBake(Geometry=ln)
